# Grasshopper definition dingdong.gh (Grasshopper 1.0.8)
# plug-ins: bertini_real Info

file_path = FilePath("/Users/amethyst/repo/bertini_real/test/curve/alpha_curve/")

file_path_2 = FilePath(["/Users/amethyst/repo/bertini_real/test/surface/dingdong/br_piece_smooth_2-7-8.stl", "/Users/amethyst/repo/bertini_real/test/surface/dingdong/br_piece_smooth_0-1-3.stl"])
surface_import_stl_pieces = SurfaceImportSTLPieces(FilePaths=file_path_2, Import_toggle=Toggle(True), Reset_button=Button())  # -> Commands, Geometry

curveread = CurveReadFromRaw(Directory=file_path)  # -> Vertices, EdgeIndices
points = PointList(Points=curveread.Vertices, Size=Slider(0.04, range=0.01..1))
lng = ListLength(List=curveread.EdgeIndices)  # -> flatten(Length)
larger = LargerThan(FirstNumber=lng, SecondNumber=Slider(1, range=0..1))  # -> LargerThan, OrEqualTo
item = ListItem(List=curveread.Vertices, Index=curveread.EdgeIndices, Wrap=True)
connnectors = Connnectors(
    WireHoleDiameter=7,
    PlugLengthFactor=3.4,
    WedgeHeight=4,
    WedgeLength=2,
    WedgeWidth=2,
    CutoutThickness=1.4,
    CutoutDepth=10,
    TabThickness=2.76,
    TaperFactor=0.7,
    TaperLength=5,
    SocketDiameter=15,
    SocketWallThickness=2,
    SocketLength=7,
    SocketLengthFactor=3,
    ConnectionPlay=0.2,
    BodyOverlap=7,
    LengthOverage=7,
    Eps=0.1,
    Base=PlaneXY(0, 0, 0))  # -> NegativePlug, PositivePlug, NegativeSocket, PositiveSocket, Debug
file_path_3 = FilePath("/Users/amethyst/repo/bertini_real/test/surface/dingdong/br_surf_piece_data.json")
pline = PolyLine(Vertices=item, Closed=False)
surface_place_components = SurfacePlaceComponents(
    FilePath=file_path_3,
    Size=Slider(0.006, range=0.001..0.1),
    PlugNegative=connnectors.NegativePlug,
    PlugPositive=connnectors.PositivePlug,
    SocketNegative=connnectors.NegativeSocket,
    SocketPositive=connnectors.PositiveSocket)  # -> PlugsNegative, PlugsPos, SocketsNeg, SocketPos, PieceFilenames
